# Grasshopper definition pickandplace try 22 on vertical wall.gh (Grasshopper 1.0.7)
# plug-ins: Excel, KUKA|prc - parametric robot control, LunchBox, Octopus, Wallacei, TT Toolbox

# ---- group: original input
# module
# facade component
geo = Geometry(<brep referenced from the Rhino model>)
# no need fot this point instead i need to make a picking location for the grip
# picking location
pt = Point(<point referenced from the Rhino model>)
# placing location
# facade wall
# excel sheet save address on the local machine
srf = Surface(<surface referenced from the Rhino model>)

# ----
# facade component
# picking location
# pick stacking option
geo_2 = Geometry(<brep referenced from the Rhino model>)
pt_2 = Point(Point(11170.78896, 4287.009268, 0))
list = ValueList({"unique place": 0, "side by side": 1, "stacked": 2}, selected="unique place")

# ----
# placing location
# building envelope
srf_2 = Surface(<surface referenced from the Rhino model>)

# ----
# press to generate BoQ
# excel sheet save address
#  on the local machine
button = Button()
panel = Panel("C:\Users\USER6459\OneDrive - 중앙대학교\PhD\grasshopper\robot\paper\Excel\quantity.xlsx")

button_2 = Button()
panel_2 = Panel("C:\Users\USER6459\OneDrive - 중앙대학교\PhD\grasshopper\robot\paper\Excel\quantity.xlsx")
srf_3 = Surface(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)

# ----
# pick X
# pick y
# rotation angle
# 2033 max x , y
# because kukaprc 30/60 ha max reach radias 2033 mm
# -1084 in the backside
pick_rotation_angle = GenePool(Decimals=0, Maximum=1, Minimum=0, Value=0)
pick_xy_coordinates = GenePool(Decimals=2, Maximum=2033, Minimum=-1084, Value=[1121.93, -1036.22])

item = ListItem(List=pick_xy_coordinates, Index=0, Wrap=True)  # -> Item, Item1

panel_3 = Panel("picking module")
geo_3 = Geometry(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)
area = Area(Geometry=geo_3)  # -> Area, Centroid
Z = UnitZ(Factor=1)
move = Move(Geometry=area.Centroid, Motion=Z)  # -> Geometry, Transform
pdecon = Deconstruct(Point=area.Centroid)  # -> XComponent, YComponent, ZComponent
pt_3 = ConstructPoint(XCoordinate=item.Item, YCoordinate=item.Item1, ZCoordinate=pdecon.ZComponent)
vec2pt = Vector2Pt(PointA=area.Centroid, PointB=pt_3, Unitize=False)  # -> Vector, Length
pi = Pi(Factor=pick_rotation_angle)
move_2 = Move(Geometry=geo_3, Motion=vec2pt.Vector)  # -> Geometry, Transform
rotate = Rotate(Geometry=move_2.Geometry, Angle=pi, Plane=move.Geometry)  # -> Geometry, Transform

geo_4 = Geometry(rotate.Geometry)

# ----
# extract only buttom face of the
#  facade component to place it on the wall
bbox = BoundingBox(Content=geo_4, Plane=PlaneXY(0, 0, 0))  # -> Box, Box_2
debrep = DeconstructBrep(Brep=bbox.Box)  # -> Faces, Edges, Vertices
area_2 = Area(Geometry=bbox.Box)  # -> Area, Centroid
facen = FaceNormals(Mesh=debrep.Faces)  # -> Centers, Normals
devec = DeconstructVector(Vector=facen.Normals)  # -> XComponent, YComponent, ZComponent
equals = Equality(FirstNumber=devec.ZComponent, SecondNumber="-1")  # -> Equality, Inequality
cullf = CullFaces(Mesh=graft(debrep.Faces), Pattern=equals.Inequality)

panel_4 = Panel("""900
500
0""")
panel_5 = Panel("office")
brep = Brep([<brep referenced from the Rhino model> x6])
place_xy_coordinates = GenePool(Decimals=2, Maximum=2033, Minimum=-1084, Value=[-75.59, -523.85])

rotation_angle = Slider(0, range=-0.5..0.5)
number_slider = Slider(249, range=-1084..2033)
number_slider_2 = Slider(119, range=-2033..2033)
panel_6 = Panel("""place X
place y""")

panel_7 = Panel("""100
1300
0""")
# Step 1:
# place facade object on the wall in GH
item_2 = ListItem(List=place_xy_coordinates, Index=0, Wrap=True)  # -> Item, Item1

panel_8 = Panel("placing wall")
explode = Explode(Curve=srf_3, Recursive=True)  # -> Segments, Vertices
Z_2 = UnitZ(Factor=1)
cp = ClosestPoint(Point=pt_3, Cloud=explode.Vertices)  # -> ClosestPoint, CPIndex, Distance
move_3 = Move(Geometry=cp.ClosestPoint, Motion=Z_2)  # -> Geometry, Transform
pt_4 = Point(cp.ClosestPoint)
pi_2 = Pi(Factor=rotation_angle)
pt_5 = ConstructPoint(XCoordinate=item_2.Item, YCoordinate=item_2.Item1, ZCoordinate=0)
vec2pt_2 = Vector2Pt(PointA=pt_4, PointB=pt_5, Unitize=False)  # -> Vector, Length
# Step 2:
# Distribute the facade components on the fabricated grid
# with correspondant labeled codes
# fabrication stage
# distribute the components on
# the flat fabrication plane
move_4 = Move(Geometry=srf_3, Motion=vec2pt_2.Vector)  # -> Geometry, Transform
rotate_2 = Rotate(Geometry=move_4.Geometry, Angle=pi_2, Plane=move_3.Geometry)  # -> Geometry, Transform

srf_4 = Surface(rotate_2.Geometry)
quads = QuadPanels(Surface=srf_4, UDivisions=Slider(16, range=0..100), VDivisions=Slider(18, range=0..100))
Y = UnitY(Factor=Slider(3799, range=0..100000))
X = UnitX(Factor=Slider(100, range=0..100))
crv = Curve([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])

# ---- group: RMIT Design hub model
unit_y = UnitY(Factor=Slider(12.5, range=0..100))
curve = Curve(crv)
point_on_curve = PointOnCurve(curve, parameter=0.25)
point_on_curve_2 = PointOnCurve(curve, parameter=0.75)
extrude = Extrude(Base=curve, Direction=unit_y)
md_slider = MDSlider(
    SliderMode=0,
    slider_value=Point(0.763100337, 0.6803851348, 0.5),
    x_domain=Domain(0, 1),
    y_domain=Domain(0, 1),
    z_domain=Domain(0, 1))
bounding_box = BoundingBox(Content=curve, Plane=PlaneXY(0, 0, 0), UnionBox=True)  # -> Box, Box_2
line = Line(StartPoint=point_on_curve, EndPoint=point_on_curve_2)
evaluate_surface = EvaluateSurface(Surface=reparameterize(bounding_box.Box), Point=md_slider)  # -> Point, Normal, UDirection, VDirection, Frame
area_3 = Area(Geometry=curve)  # -> Area, Centroid
distance = Distance(PointA=area_3.Centroid, PointB=evaluate_surface.Point)
remap = Remap(data=distance, min=Slider(80, range=0..100), max=Slider(0, range=0..100))
rotate_axis = RotateAxis(Geometry=curve, Angle=degrees(remap), Axis=line)  # -> Geometry, Transform
surface = Surface(rotate_axis.Geometry)

# ----
number_slider_3 = Slider(33, range=0..100)
# Step 3:
# kuka pick and place from the fabrication location to the designated facade wall
preview = CustomPreview(
    Geometry=surface,
    Material={diffuse=RGB(221, 160, 221), emission=RGB(66, 48, 66), shine=0.5, specular=RGB(255, 255, 255), transparency=0})
geo_5 = Geometry(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)
preview_2 = CustomPreview(Geometry=geo_5, Material=ColourSwatch(SwatchColor=RGB(224, 220, 220)))
preview_3 = CustomPreview(Geometry=geo_4, Material=ColourSwatch(SwatchColor=RGB(0, 255, 187)))

# ---- group: angle positioning / pick place rotatin angle
number_slider_4 = Slider(90, range=0..360)

# ----
panel_9 = Panel("Placing Center X-Coordinate")
panel_10 = Panel("Placing Center Y-Coordinate")
panel_11 = Panel("Placing Center Z-Coordinate")
panel_12 = Panel("Robot Center Coordinates")
panel_13 = Panel("picking buttom face Center Coordinates")
# linear rail
# min distance 1200
# ideal distance 1500
# max distance 1800
number_slider_5 = Slider(509, range=0..2600)
crv_2 = Curve(<curve referenced from the Rhino model>)
# robot joint safe rotation hemispheres
crv_3 = Curve(<curve referenced from the Rhino model>)
crv_4 = Curve(<curve referenced from the Rhino model>)
pt_6 = ConstructPoint(XCoordinate=0, YCoordinate=0, ZCoordinate=number_slider_5)
# robot total safe movemet space
crv_5 = Curve(<curve referenced from the Rhino model>)
brep_2 = Brep([<brep referenced from the Rhino model> x4])  # disabled
brep_3 = Brep(<brep referenced from the Rhino model>)  # disabled
end = EndPoints(Curve=crv_5)  # -> Start, End
circle = Circle(crv_2)
circle_2 = Circle(crv_4)
circle_3 = Circle(crv_3)
sint = SolidIntersection(BrepsA=brep_3, BrepsB=brep_2)  # disabled
ln = Line(StartPoint=end.Start, EndPoint=end.End)
eval = EvaluateCurve(Curve=crv_2, Parameter=Slider(0.25, range=0..1))  # -> Point, Tangent, Angle; disabled
eval_2 = EvaluateCurve(Curve=crv_3, Parameter=Slider(0.25, range=0..1))  # -> Point, Tangent, Angle; disabled
eval_3 = EvaluateCurve(Curve=crv_4, Parameter=Slider(0.25, range=0..1))  # -> Point, Tangent, Angle; disabled
area_4 = Area(Geometry=circle)  # -> Area, Centroid; disabled
area_5 = Area(Geometry=circle_3)  # -> Area, Centroid; disabled
area_6 = Area(Geometry=circle_2)  # -> Area, Centroid; disabled
join = JoinCurves(Curves=[crv_5, ln], Preserve=False)  # disabled
topoly = CurveToPolyline(Curve=join, ToleranceDistance=0, ToleranceAngle=0)  # -> Polyline, Segments
panel_14 = Panel(sint)  # disabled
dist = Distance(PointA=eval.Point, PointB=area_4.Centroid)  # disabled
dist_2 = Distance(PointA=eval_3.Point, PointB=area_6.Centroid)  # disabled
dist_3 = Distance(PointA=eval_2.Point, PointB=area_5.Centroid)  # disabled
pcen = PolygonCenter(Polyline=topoly.Polyline)  # -> CenterV, CenterE, CenterA; disabled
area_7 = Area(Geometry=join)  # -> Area, Centroid; disabled
genes = GenePool(Decimals=2, Maximum=100, Minimum=0, Value=[97.81, 33.97, 32.84])  # disabled
sph = Sphere(Base=circle, Radius=dist)  # disabled
sph_2 = Sphere(Base=circle_2, Radius=dist_2)  # disabled
sph_3 = Sphere(Base=circle_3, Radius=dist_3)  # disabled
number_slider_6 = Slider(0, range=0..100)  # disabled
number_slider_7 = Slider(3.145, range=0..11)  # disabled
Z_3 = UnitZ(Factor=1)  # disabled
move_5 = Move(Geometry=pcen.CenterV, Motion=Z_3)  # -> Geometry, Transform; disabled
cir = Circle(Plane=pt_6, Radius=[Slider(1576, range=0..10000), Slider(2102, range=0..10000), Slider(930, range=0..10000)])  # disabled
end_2 = EndPoints(Curve=crv_2)  # -> Start, End; disabled
end_3 = EndPoints(Curve=crv_4)  # -> Start, End; disabled
end_4 = EndPoints(Curve=crv_3)  # -> Start, End; disabled
number_slider_8 = Slider(2, range=0..10)  # disabled
dim = Dimensions(Surface=cir)  # -> UDimension, VDimension; disabled
ln_2 = Line(StartPoint=pcen.CenterE, EndPoint=move_5.Geometry)  # disabled
Z_4 = UnitZ(Factor=genes)  # disabled
fcircle = CircleFit(Points=[end_2.Start, end_2.End])  # -> Circle, Radius, Deviation; disabled
ln_3 = Line(StartPoint=end_4.Start, EndPoint=end_4.End)  # disabled
fcircle_2 = CircleFit(Points=[end_3.Start, end_3.End])  # -> Circle, Radius, Deviation; disabled
len = Length(Curve=ln_3)  # disabled
number_slider_9 = Slider(1, range=0..1)  # disabled
number_slider_10 = Slider(0, range=0..1)  # disabled
dom² = ConstructDomain²(DomainU=Domain(0, 1), DomainV=number_slider_7)  # disabled
eval_4 = EvaluateCurve(Curve=ln_3, Parameter=0.5)  # -> Point, Tangent, Angle; disabled
extr = Extrude(Base=cir, Direction=Z_4)  # disabled
swatch = ColourSwatch(SwatchColor=RGB(8, 0, 255))  # disabled
swatch_2 = ColourSwatch(SwatchColor=RGB(0, 255, 85))  # disabled
swatch_3 = ColourSwatch(SwatchColor=RGB(255, 0, 0))  # disabled
division = Division(A=len, B=2)  # disabled
split = SplitBrep(Brep=sph, Cutter=fcircle.Circle)  # disabled
split_2 = SplitBrep(Brep=sph_2, Cutter=fcircle_2.Circle)  # disabled
eval_5 = EvaluateCurve(Curve=cir, Parameter=1)  # -> Point, Tangent, Angle; disabled
division_2 = Division(A=dim.UDimension, B=number_slider_8)  # disabled
revsrf = Revolution(Curve=join, Axis=ln_2, Domain=dom²)  # disabled
panel_15 = Panel("Ideal Distance =")  # disabled
panel_16 = Panel("Max Distance =")  # disabled
panel_17 = Panel("Min Distance = ")  # disabled
sph_4 = Sphere(Base=eval_4.Point, Radius=division)  # disabled
number_slider_11 = Slider(200, range=0..1000)  # disabled
item_3 = ListItem(List=split_2, Index=number_slider_10, Wrap=True)  # disabled
item_4 = ListItem(List=split, Index=number_slider_9, Wrap=True)  # disabled
sdiff = SolidDifference(BrepsA=sph_3, BrepsB=sph_4)  # disabled
concat = Concatenate(FragmentA=[panel_15, panel_16, panel_17], FragmentB=division_2)  # disabled
Y_2 = UnitY(Factor=number_slider_11)  # disabled
number_slider_12 = Slider(-150, range=-1160..100)  # disabled
move_6 = Move(Geometry=eval_5.Point, Motion=Y_2)  # -> Geometry, Transform; disabled
swatch_4 = ColourSwatch(SwatchColor=RGBA(8, 0, 255, 133))  # disabled
ln_4 = Line(StartPoint=eval_5.Point, EndPoint=move_6.Geometry)  # disabled
preview_4 = CustomPreview(Geometry=[extr, ln_4], Material=[swatch_2, swatch_3, swatch])  # disabled
X_2 = UnitX(Factor=number_slider_12)  # disabled
move_7 = Move(Geometry=move_6.Geometry, Motion=X_2)  # -> Geometry, Transform; disabled
tag = TextTag(Location=move_7.Geometry, Text=concat, Colour=[swatch_2, swatch_3, swatch])  # disabled
panel_18 = Panel("envelop wall collision")
kr30_60 = KR3060HARobot(infiniterot=False)
Y_3 = UnitY(Factor=Slider(100, range=0..100))
move_8 = Move(Geometry=srf_4, Motion=Y_3)  # -> Geometry, Transform
mesh = Mesh(move_8.Geometry)
mesh_2 = Mesh(srf_4)
panel_19 = Panel("if X = 0")
panel_21 = Panel("reduce time")
mesh_3 = Mesh(srf_4)
mesh_4 = Mesh(geo_4)
mesh_5 = Mesh(flatten(mesh_4))
pdecoder = DecodePhenotype()  # -> GeometriesList, MeshesList, NumbersList, TextList; disabled
galapagos = Galapagos(fitness=collision_detection_4, gene=[pick_xy_coordinates, pick_rotation_angle, place_xy_coordinates])
mesh_6 = Mesh(pdecoder.MeshesList)  # disabled
panel_22 = Panel(pdecoder.MeshesList)  # disabled
panel_23 = Panel(mesh_6)

# ----
# robot arm
# brand selection
# grip tool
# grip tool angle setting
# kuka|Prc core setting
# -command
# -analysis output
# -collision
# -reachability
# -time value
list_2 = ValueList({"KR30-60": 0, "side by side": 1, "stacked": 2}, selected="KR30-60")
mesh_7 = Mesh(<mesh referenced from the Rhino model>)
custom_tool = CustomToolForKUKAPrc(
    CustomToolGeometry=mesh_7,
    toolid=6,
    toolvala=0,
    toolvalb=-90,
    toolvalc=0,
    toolvalx=0,
    toolvaly=0,
    toolvalz=185,
    valuesset=True)
# collision objects
brep_4 = Brep([<brep referenced from the Rhino model> x5])

# ---- group: collision objects
number_slider_13 = Slider(653, range=0..1000)
pt_7 = ConstructPoint(XCoordinate=number_slider_13, YCoordinate=number_slider_13, ZCoordinate=0)
rectangle = Rectangle(Plane=pt_7, XSize=number_slider_13, YSize=number_slider_13, Radius=0)  # -> Rectangle, Length
Z_5 = UnitZ(Factor=Slider(1000, range=0..1000))
mesh_8 = Mesh(brep_4)
mesh_9 = MeshBrep(
    Brep=brep_4,
    Settings={GridMaxCount=0, GridMinCount=16, JaggedSeams=False, MaxEdgeLength=0, MinEdgeLength=0.0001, MinTolerance=0, Refine=True, RefineAngle=0, RelativeTolerance=0.65, SimplePlanes=True, Tolerance=0})
extr_2 = Extrude(Base=rectangle.Rectangle, Direction=Z_5)
flatten = FlattenTree(Tree=[mesh_8, mesh], Path="{0}")

# ----
filter = StreamFilter(Gate=list_2, Stream0=kr30_60)
preview_5 = CustomPreview(
    Geometry=flatten,
    Material={diffuse=RGB(221, 160, 221), emission=RGB(66, 48, 66), shine=0.5, specular=RGB(255, 255, 255), transparency=0})

# ----
# optimization fitness objectives
sqr = Square(Value="0")
sqr_2 = Square(Value="0")
ma = MassAddition(Input=sqr)  # -> Result, PartialResults
ma_2 = MassAddition(Input=sqr_2)  # -> Result, PartialResults
ma_3 = MassAddition(Input=Slider(3640, range=0..10000))  # -> Result, PartialResults
collision_detection = Number(expr("x", flatten(ma.Result)))
robot_reachability = Number(expr("x", flatten(ma_2.Result)))
time_value = Number(expr("x", flatten(ma_3.Result)))
merge = Merge(Data1=collision_detection, Data2=robot_reachability, Data3=time_value)
merge_2 = Merge(Data1="Collision", Data2="Reachability", Data3="Time Value")

# ---- group: numeric objective values
collision_detection_2 = Number(merge)

# ---- group: textual objectives description
txt = Text(merge_2)

# ----
# divide picking place x length on object bottom x length
number_slider_14 = Slider(8, range=0..10)
faceb = FaceBoundaries(Mesh=cullf)
edges = BrepEdges(Brep=bbox.Box)  # -> Naked, Interior, NonManifold
explode_2 = Explode(Curve=faceb, Recursive=True)  # -> Segments, Vertices
item_5 = ListItem(List=edges.Interior, Index=number_slider_14, Wrap=True)
item_6 = ListItem(List=explode_2.Segments, Index=1, Wrap=True)
item_7 = ListItem(List=explode_2.Segments, Index=0, Wrap=True)
len_2 = Length(Curve=item_6)
len_3 = Length(Curve=item_5)
len_4 = Length(Curve=item_7)
clean = CleanTree(RemoveNulls=True, RemoveInvalid=True, RemoveEmpty=True, Tree=len_3)  # -> simplify(Tree)
clean_2 = CleanTree(RemoveNulls=True, RemoveInvalid=True, RemoveEmpty=True, Tree=len_4)  # -> simplify(Tree)
clean_3 = CleanTree(RemoveNulls=True, RemoveInvalid=True, RemoveEmpty=True, Tree=len_2)  # -> simplify(Tree)

panel_24 = Panel(collision_detection_2)
panel_25 = Panel(txt)

# ---- group: picking place surface / new side by side grid
addition = Addition(A=pick_rotation_angle, B=Slider(1, range=0..1))
clean_4 = CleanTree(RemoveNulls=True, RemoveInvalid=True, RemoveEmpty=True, Tree=cullf)
pi_3 = Pi(Factor=addition)
neg = Negative(Value=len_2)
neg_2 = Negative(Value=len_4)
demesh = DeconstructMesh(Mesh=clean_4)  # -> Vertices, Faces, Colours, Normals
item_8 = ListItem(List=demesh.Vertices, Index=Slider(2, range=0..10), Wrap=True)
xy = XYPlane(Origin=item_8)
prot = RotatePlane(Plane=xy, Angle=pi_3)

# ---- group: morphing process
geo_6 = Geometry(bbox.Box)

# ---- group: stacked picking option
number_slider_15 = Slider(422, range=0..1000)

# ----
# robot working frame
number_slider_16 = Slider(4, range=0..100)
panel_26 = Panel("create grid")
quads_2 = QuadPanels(Surface=srf_4, UDivisions=number_slider_16, VDivisions=Slider(6, range=0..100))
pipe = Pipe(Curve=quads_2, Radius=Slider(47, range=0..100), Caps=0)
area_8 = Area(Geometry=quads)  # -> Area, Centroid
item_9 = ListItem(List=quads_2, Index=0, Wrap=True)  # -> flatten(Item)
pt_8 = Point(area_8.Centroid)
incurve = PointInCurve(Point=simplify(flatten(pt_8)), Curve=simplify(item_9))  # -> Relationship, Point
larger = LargerThan(FirstNumber=incurve.Relationship, SecondNumber="1")  # -> LargerThan, OrEqualTo
cull = CullPattern(List=quads, CullPattern=larger.LargerThan)
flatten_2 = FlattenTree(Tree=cull, Path="{0}")

area_9 = Area(Geometry=cull)  # -> Area, Centroid
pdecon_2 = Deconstruct(Point=area_9.Centroid)  # -> XComponent, YComponent, ZComponent
sort = SortList(Keys=cull, ValuesA=pdecon_2.YComponent)  # -> Keys, ValuesA
c_script = CSharpScript(T=sort.ValuesA)  # -> out, A; inputs T: tree of Int32
# ---------- c_script: C# ----------
    DataTree<int> tree = new DataTree<int>();

    // Repeat while we have branches in our tree.
    while (T.BranchCount > 0)
    {
      // Create a new HashSet from the first branch, 
      // then delete the first branch.
      HashSet<int> cluster = new HashSet<int>();
      
      GH_Path path = T.Path(0);
      cluster.UnionWith(T.Branch(path));
      T.RemovePath(path);

      // Now keep on iterating through all remaining branches,
      // and merge/delete them with the current cluster.
      // Only stop iterating if the last iteration was pointless.
      
      bool pointless = false;
      while (!pointless)
      {
        pointless = true;
        for (int i = T.BranchCount - 1; i >= 0; i--)
        {
          GH_Path localPath = T.Path(i);
          if (cluster.Overlaps(T.Branch(localPath)))
          {
            cluster.UnionWith(T.Branch(localPath));
            T.RemovePath(localPath);
            pointless = false;
          }
        }
      }

      if (cluster.Count > 0)
        tree.AddRange(cluster, new GH_Path(tree.BranchCount));
      
      if (T.BranchCount == 0)
        break;
    }

    A = tree;
# ---------- end c_script ----------
lng = ListLength(List=c_script.A)
partition = PartitionList(List=cull, Size=lng)
lng_2 = ListLength(List=partition)  # -> flatten(Length)
lng_3 = ListLength(List=lng_2)

# ---- group: picking place surface / new side by side grid (continued)
multiplication = Multiplication(A=len_2, B=lng)
neg_3 = Negative(Value=multiplication)
Y_4 = UnitY(Factor=neg_3)
move_9 = Move(Geometry=prot, Motion=Y_4)  # -> Geometry, Transform
recgrid = Rectangular(Plane=move_9.Geometry, SizeX=neg, SizeY=neg_2, ExtentX=lng, ExtentY=lng_3)  # -> Cells, Points

# ---- group: picking place surface
boundary = BoundarySurfaces(Edges=recgrid.Cells)  # -> flatten(Surfaces)
join_2 = BrepJoin(Breps=boundary)  # -> Breps, Closed
srf_5 = Surface(join_2.Breps)

# ----
debrep_2 = DeconstructBrep(Brep=srf_5)  # -> Faces, Edges, Vertices
item_10 = ListItem(List=debrep_2.Edges, Index=0, Wrap=True)
len_5 = Length(Curve=item_10)
division_3 = Division(A=len_5, B=len_2)
divide = DivideDomain²(Domain=srf_5, UCount=lng, VCount=lng_3)

# ---- group: morphing process (continued)
sbox = SurfaceBox(Surface=srf_5, Domain=divide, Height=clean)
morph = BoxMorph(Geometry=geo_4, Reference=geo_6, Target=sbox)  # -> graft(Geometry)
area_10 = Area(Geometry=morph)  # -> Area, Centroid
clean_5 = CleanTree(RemoveNulls=True, RemoveInvalid=True, RemoveEmpty=True, Tree=morph)

# ----
# sort panels by z
pdecon_3 = Deconstruct(Point=area_10.Centroid)  # -> XComponent, YComponent, ZComponent
sort_2 = SortList(Keys=pdecon_3.ZComponent, ValuesA=clean_5)  # -> Keys, ValuesA

lng_4 = ListLength(List=flatten(sort_2.ValuesA))
split_3 = SplitList(List=flatten_2, Index=lng_4)  # -> ListA, ListB
crv_6 = Curve(split_3.ListA)

number_slider_17 = Slider(1, range=0..1)
panel_27 = Panel("create text sequence")
series = Series(Start=number_slider_17, Step=number_slider_17, Count=lng_4)
graft = GraftTree(Tree=series, IncludeEmptyLists=True, IncludeNullItems=True)
simplify = SimplifyTree(Tree=graft, Front=False)
int = Integer(simplify)

# ----
# move tiles to grid
area_11 = Area(Geometry=crv_6)  # -> Area, Centroid
bbox_2 = BoundingBox(Content=clean_5, Plane=PlaneXY(0, 0, 0))  # -> Box, Box_2
area_12 = Area(Geometry=bbox_2.Box)  # -> Area, Centroid
graft_2 = GraftTree(Tree=area_11.Centroid, IncludeEmptyLists=True, IncludeNullItems=True)
vec2pt_3 = Vector2Pt(PointA=area_12.Centroid, PointB=graft_2, Unitize=False)  # -> Vector, Length
move_10 = Move(Geometry=clean_5, Motion=vec2pt_3.Vector)  # -> Geometry, Transform

panel_28 = Panel("3d Labels")
area_13 = Area(Geometry=sort_2.ValuesA)  # -> Area, Centroid
concat_2 = Concatenate(FragmentA="WS_1_", FragmentB=int)
tag_2 = TextTag(Location=flatten(graft_2), Text=flatten(concat_2), Colour=ColourSwatch(SwatchColor=RGB(0, 0, 0)))
tag_3 = TextTag(Location=flatten(area_13.Centroid), Text=flatten(concat_2))

# ---- group: optimization triangle / placing centerpoint
bbox_3 = BoundingBox(Content=crv_6, Plane=PlaneXY(0, 0, 0), UnionBox=True)  # -> Box, Box_2
area_14 = Area(Geometry=bbox_3.Box)  # -> Area, Centroid

# ---- group: optimization triangle
pt_9 = ConstructPoint(XCoordinate=0, YCoordinate=0, ZCoordinate=0)
area_15 = Area(Geometry=faceb)  # -> Area, Centroid
srf4pt = _4PointSurface(CornerA=area_14.Centroid, CornerB=pt_9, CornerC=area_15.Centroid)
sph_5 = Sphere(Base=[area_14.Centroid, pt_9, area_15.Centroid], Radius=Slider(33, range=0..1000))
swatch_5 = ColourSwatch(SwatchColor=RGBA(111, 227, 210, 141))
swatch_6 = ColourSwatch(SwatchColor=RGBA(111, 125, 227, 141))

# ----
preview_6 = CustomPreview(Geometry=sph_5, Material=swatch_6)  # disabled

# ---- group: first poistion location
explode_3 = Explode(Curve=srf4pt, Recursive=True)  # -> Segments, Vertices
item_11 = ListItem(List=explode_3.Segments, Index=0, Wrap=True)
item_12 = ListItem(List=explode_3.Segments, Index=1, Wrap=True)
item_13 = ListItem(List=explode_3.Segments, Index=2, Wrap=True)
len_6 = Length(Curve=item_11)  # -> flatten(Length)
len_7 = Length(Curve=item_12)  # -> flatten(Length)
len_8 = Length(Curve=item_13)  # -> flatten(Length)
clean_6 = CleanTree(RemoveNulls=True, RemoveInvalid=True, RemoveEmpty=False, Tree=len_6)
clean_7 = CleanTree(RemoveNulls=True, RemoveInvalid=True, RemoveEmpty=False, Tree=len_7)
clean_8 = CleanTree(RemoveNulls=True, RemoveInvalid=True, RemoveEmpty=False, Tree=len_8)
panel_29 = Panel(clean_7)
panel_30 = Panel(clean_6)
panel_31 = Panel(clean_8)
panel_32 = Panel("robot-pick distance(mm)")
panel_33 = Panel("pick-place center distance(mm)")
panel_34 = Panel("place center-robot distance(mm)")

# ----
move_11 = Move(Geometry=explode_3.Vertices, Motion=X)  # -> Geometry, Transform

# ---- group: all poistions location
geo_7 = Geometry(quads_2)
area_16 = Area(Geometry=geo_7)  # -> Area, Centroid
lng_5 = ListLength(List=area_16.Centroid)
flatten_3 = FlattenTree(Tree=lng_5, Path="{0}")
series_2 = Series(Start="1", Step="1", Count=flatten_3)
vec2pt_4 = Vector2Pt(PointA=area_14.Centroid, PointB=area_16.Centroid, Unitize=False)  # -> Vector, Length
concat_3 = Concatenate(FragmentA="Workstation_", FragmentB=series_2)
move_12 = Move(Geometry=srf4pt, Motion=vec2pt_4.Vector)  # -> Geometry, Transform
swatch_7 = ColourSwatch(SwatchColor=RGB(13, 17, 255))
explode_4 = Explode(Curve=move_12.Geometry, Recursive=True)  # -> Segments, Vertices
cullduppoints = RemoveDuplicatePoints(InputPoints=explode_4.Vertices, Tolerance=0.001)  # -> OutputPoints, FirstPointIndexes
clean_9 = CleanTree(RemoveNulls=True, RemoveInvalid=True, RemoveEmpty=True, Tree=cullduppoints.OutputPoints)
item_14 = ListItem(List=clean_9, Index=1, Wrap=True)  # -> flatten(Item), flatten(Item1), flatten(Item2)
points = PointList(Points=clean_9, Size=Slider(131, range=0..1000))
tag_4 = TextTag(Location=area_16.Centroid, Text=concat_3, Colour=swatch_7)

# ---- group: total Workstations Excel
repeat = RepeatData(Data=panel_30, Length=lng_5)  # -> flatten(Data)
repeat_2 = RepeatData(Data=panel_33, Length=lng_5)  # -> flatten(Data)
repeat_3 = RepeatData(Data=panel_31, Length=lng_5)  # -> flatten(Data)
panel_35 = Panel(panel_32)
panel_36 = Panel(panel_32)
panel_37 = Panel(panel_34)
flatten_4 = FlattenTree(Tree=concat_3, Path="{0}")
merge_3 = Merge(Data1="Pick place all location coordinates", Data2=item_14.Item)  # -> flatten(Result)
merge_4 = Merge(Data1=panel_35, Data2=repeat)
merge_5 = Merge(Data1="Placing center coordinates", Data2=area_16.Centroid)  # -> flatten(Result)
merge_6 = Merge(Data1="Robot all location coordinates", Data2=item_14.Item2)  # -> flatten(Result)
merge_7 = Merge(Data1="Placing TAG(BAR-CODE)", Data2=flatten_4)
merge_8 = Merge(Data1=panel_36, Data2=repeat_2)
merge_9 = Merge(Data1=panel_37, Data2=repeat_3)
path_mapper = PathMapper(merge_4, source="{C}", target="{4;c}")
path_mapper_2 = PathMapper(merge_8, source="{C}", target="{5;c}")
path_mapper_3 = PathMapper(merge_9, source="{C}", target="{6;c}")
path_mapper_4 = PathMapper(merge_3, source="{C}", target="{3;c}")
path_mapper_5 = PathMapper(merge_5, source="{C}", target="{1;c}")
path_mapper_6 = PathMapper(merge_6, source="{C}", target="{2;c}")
path_mapper_7 = PathMapper(merge_7, source="{C}", target="{0;c}")
merge_10 = Merge(
    Data1=path_mapper_7,
    Data2=path_mapper_5,
    Data3=path_mapper_6,
    Data4=path_mapper_4,
    Data5=path_mapper,
    Data6=path_mapper_2,
    Data7=path_mapper_3)
write = ExcelWrite(
    Start=button_2,
    FilePath=panel_2,
    SheetName="Sheet0",
    Title="Total Building Envelope Robot/facade placement BoQ",
    Cell="A1",
    Data=merge_10)

# ----
xz = XZPlane(Origin=area_11.Centroid)
area_17 = Area(Geometry=move_10.Geometry)  # -> Area, Centroid
orient = Orient(Geometry=move_10.Geometry, Source=area_17.Centroid, Target=xz)  # -> Geometry, Transform
item_15 = ListItem(List=flatten([area_14.Centroid, pt_9, area_15.Centroid]), Index=0, Wrap=True)  # -> Item, Item1, Item2
points_2 = PointList(Points=move_11.Geometry, Size=Slider(100, range=0..100))
sph_6 = Sphere(Base=item_15.Item, Radius=number_slider_3)
cyl = Cylinder(Base=item_15.Item2, Radius=number_slider_3, Length=number_slider_3)
box = DomainBox(Base=item_15.Item1, X=number_slider_3, Y=number_slider_3, Z=number_slider_3)
crv_7 = Curve(explode_4.Segments)
concat_4 = Concatenate(FragmentA="WS_", FragmentB=series_2)
item_16 = ListItem(List=geo_7, Index=Slider(10, range=0..10), Wrap=True)
boundary_2 = BoundarySurfaces(Edges=crv_7)
tag_5 = TextTag(Location=area_16.Centroid, Text=concat_4, Colour=swatch_7)
preview_7 = CustomPreview(Geometry=item_16, Material=ColourSwatch(SwatchColor=RGB(0, 72, 255)))
preview_8 = CustomPreview(Geometry=boundary_2, Material=ColourSwatch(SwatchColor=RGBA(231, 255, 77, 87)))  # disabled
int_2 = Integer(simplify)

# ---- group: WS_1 Excel
clean_10 = CleanTree(RemoveNulls=True, RemoveInvalid=True, RemoveEmpty=True, Tree=area_15.Centroid)  # -> flatten(Tree)
pdecon_4 = Deconstruct(Point=area_11.Centroid)  # -> flatten(XComponent), flatten(YComponent), flatten(ZComponent)
lng_6 = ListLength(List=pdecon_4.XComponent)
repeat_4 = RepeatData(Data=pt_9, Length=lng_6)  # -> flatten(Data)
repeat_5 = RepeatData(Data=clean_10, Length=lng_6)  # -> flatten(Data)
repeat_6 = RepeatData(Data=panel_30, Length=lng_6)  # -> flatten(Data)
repeat_7 = RepeatData(Data=panel_29, Length=lng_6)  # -> flatten(Data)
repeat_8 = RepeatData(Data=panel_31, Length=lng_6)  # -> flatten(Data)
flatten_5 = FlattenTree(Tree=concat_2, Path="{0}")
panel_38 = Panel(panel_32)
panel_39 = Panel(panel_33)
panel_40 = Panel(panel_34)
merge_11 = Merge(Data1=panel_38, Data2=repeat_6)
merge_12 = Merge(Data1=panel_13, Data2=repeat_5)
merge_13 = Merge(Data1="Placing TAG(ID-CODE)", Data2=flatten_5)
merge_14 = Merge(Data1=panel_9, Data2=pdecon_4.XComponent)
merge_15 = Merge(Data1=panel_10, Data2=pdecon_4.YComponent)
merge_16 = Merge(Data1=panel_11, Data2=pdecon_4.ZComponent)
merge_17 = Merge(Data1=panel_12, Data2=repeat_4)
merge_18 = Merge(Data1=panel_39, Data2=repeat_7)
merge_19 = Merge(Data1=panel_40, Data2=repeat_8)
path_mapper_8 = PathMapper(merge_13, source="{C}", target="{0;c}")
path_mapper_9 = PathMapper(merge_11, source="{C}", target="{6;c}")
path_mapper_10 = PathMapper(merge_19, source="{C}", target="{8;c}")
path_mapper_11 = PathMapper(merge_12, source="{C}", target="{5;c}")
path_mapper_12 = PathMapper(merge_14, source="{C}", target="{1;c}")
path_mapper_13 = PathMapper(merge_15, source="{C}", target="{2;c}")
path_mapper_14 = PathMapper(merge_16, source="{C}", target="{3;c}")
path_mapper_15 = PathMapper(merge_17, source="{C}", target="{4;c}")
path_mapper_16 = PathMapper(merge_18, source="{C}", target="{7;c}")
merge_20 = Merge(
    Data1=path_mapper_8,
    Data2=path_mapper_12,
    Data3=path_mapper_13,
    Data4=path_mapper_14,
    Data5=path_mapper_15,
    Data6=path_mapper_11,
    Data7=path_mapper_9,
    Data8=path_mapper_16,
    Data9=path_mapper_10)
write_2 = ExcelWrite(
    Start=button_2,
    FilePath=panel_2,
    SheetName="Workstation_1",
    Title="Workstation_1 Robot-arm/Facade location Quantity take-off",
    Cell="A1",
    Data=merge_20)

# ----
geo_8 = Geometry(graft(orient.Geometry))
flatten_6 = FlattenTree(Tree=geo_8, Path="{0}")
item_17 = ListItem(List=flatten_6, Index=0, Wrap=True)  # -> Item, Item1, Item2, Item3, Item4, Item5, Item6, Item7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
geo_9 = Geometry([item_17.Item, item_17.Item1, item_17.Item2, item_17.Item3, item_17.Item4, item_17.Item5, item_17.Item6, item_17.Item7, item_17.Item8, item_17.Item9, item_17.Item10, item_17.Item11])
vec2pt_5 = Vector2Pt(PointA=area_14.Centroid, PointB=area_16.Centroid, Unitize=False)  # -> Vector, Length
graft_3 = GraftTree(Tree=geo_9, IncludeEmptyLists=True, IncludeNullItems=True)

# ---- group: pick all positions
robot_all_positions = ListItem(List=item_14.Item, Index=0, Wrap=True)  # -> Item, Item1, Item2, Item3, Item4, Item5, Item6, Item7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

# ----
move_13 = Move(Geometry=graft_3, Motion=vec2pt_5.Vector)  # -> Geometry, Transform
debrep_3 = DeconstructBrep(Brep=move_13.Geometry)  # -> Faces, Edges, Vertices
geo_10 = Geometry(debrep_3.Edges)
item_18 = ListItem(List=geo_10, Index=0, Wrap=True)
move_14 = Move(Geometry=item_18, Motion=Y)  # -> Geometry, Transform
preview_9 = CustomPreview(Geometry=geo_10, Material=ColourSwatch(SwatchColor=RGB(173, 127, 173)))

# ---- group: place all positions
item_19 = ListItem(List=move_13.Geometry, Index=0, Wrap=True)  # -> flatten(Item), Item1, Item2, Item3, Item4, Item5, Item6, Item7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

# ----
robot_all_positions_2 = ListItem(List=item_14.Item2, Index=0, Wrap=True)  # -> Item, Item1, Item2, Item3, Item4, Item5, Item6, Item7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
preview_10 = CustomPreview(Geometry=[srf4pt, move_12.Geometry], Material=swatch_5)  # disabled
preview_11 = CustomPreview(Geometry=sph_5, Material=swatch_4)  # disabled
preview_12 = CustomPreview(Geometry=pipe, Material=ColourSwatch(SwatchColor=RGBA(117, 255, 133, 94)))
mesh_10 = Mesh(srf4pt)
mesh_11 = Mesh([sph_6, cyl, box])
mesh_12 = Mesh(flatten([mesh_10, mesh_11]))
octopus = Octopus(
    Phenotype=mesh_12,
    OctopusData_gene=[pick_xy_coordinates, pick_rotation_angle, place_xy_coordinates],
    OctopusData_obj=[collision_detection_4, txt_2, bool_2])  # disabled

# ---- group: stacked picking option (continued)
lng_7 = ListLength(List=sort_2.ValuesA)
num = Number(flatten(lng_7))
lng_8 = ListLength(List=num)
division_4 = Division(A=lng_8, B=Slider(3, range=0..10))
series_3 = Series(Start=Slider(100, range=0..100), Step=Slider(250, range=0..250), Count=division_4)

# move tiles to grid
bbox_4 = BoundingBox(Content=clean_5, Plane=PlaneXY(0, 0, 0))  # -> Box, Box_2
area_18 = Area(Geometry=bbox_4.Box)  # -> Area, Centroid

# ---- group: angle positioning
panel_41 = Panel("picking place ")
panel_42 = Panel("placing area")
pt_10 = Point(area_10.Centroid)
pt_11 = Point(area_17.Centroid)
geo_11 = Geometry(geo_4)
mesh_13 = Mesh(bbox.Box)
pt_12 = Point(area_2.Centroid)
Z_6 = UnitZ(Factor=Slider(100, range=0..100))
rad = Radians(Degrees=Slider(270, range=0..400))
filter_2 = StreamFilter(
    Gate=list,
    Stream0=ColourSwatch(SwatchColor=RGB(198, 176, 255)),
    Stream1=ColourSwatch(SwatchColor=RGB(176, 255, 222)),
    Stream2=ColourSwatch(SwatchColor=RGB(252, 255, 176)))
Y_5 = UnitY(Factor=rad)
move_15 = Move(Geometry=pt_12, Motion=Z_6)  # -> Geometry, Transform
pt_13 = Point(move_15.Geometry)
move_16 = Move(Geometry=pt_11, Motion=Y_5)  # -> Geometry, Transform
xz_2 = XZPlane(Origin=pt_11)
vec2pt_6 = Vector2Pt(PointA=pt_11, PointB=move_16.Geometry, Unitize=False)  # -> Vector, Length
Z_7 = UnitZ(Factor=1)
rad_2 = Radians(Degrees=number_slider_4)
prot_2 = RotatePlane(Plane=xz_2, Angle=vec2pt_6.Vector)
align = AlignPlane(Plane=prot_2, Direction=Z_7)  # -> flatten(Plane), Angle
Y_6 = UnitY(Factor=rad_2)
Z_8 = UnitZ(Factor=Slider(100, range=0..1000))
clean_11 = CleanTree(RemoveNulls=True, RemoveInvalid=True, RemoveEmpty=True, Tree=align.Plane)
Y_7 = UnitY(Factor=Slider(-100, range=-100..0))
move_17 = Move(Geometry=align.Plane, Motion=Y_7)  # -> Geometry, Transform

# ---- group: stacked picking option (continued)
pdecon_5 = Deconstruct(Point=pt_13)  # -> XComponent, YComponent, ZComponent
addition_2 = Addition(A=pdecon_5.YComponent, B=number_slider_15)
addition_3 = Addition(A=addition_2, B=number_slider_15)
pt_14 = ConstructPoint(XCoordinate=pdecon_5.XComponent, YCoordinate=addition_2, ZCoordinate=series_3)
pt_15 = ConstructPoint(XCoordinate=pdecon_5.XComponent, YCoordinate=pdecon_5.YComponent, ZCoordinate=series_3)
pt_16 = ConstructPoint(XCoordinate=pdecon_5.XComponent, YCoordinate=addition_3, ZCoordinate=series_3)
flatten_7 = FlattenTree(Tree=[pt_16, pt_14, pt_15], Path="{0}")

graft_4 = GraftTree(Tree=flatten_7, IncludeEmptyLists=True, IncludeNullItems=True)
vec2pt_7 = Vector2Pt(PointA=area_18.Centroid, PointB=graft_4, Unitize=False)  # -> Vector, Length
move_18 = Move(Geometry=clean_5, Motion=vec2pt_7.Vector)  # -> Geometry, Transform

# ---- group: angle positioning (continued)
area_19 = Area(Geometry=move_18.Geometry)  # -> Area, Centroid
flip = FlipMatrix(Data=area_19.Centroid)
rev = ReverseList(List=flip)
filter_3 = StreamFilter(Gate=list, Stream0=geo_11, Stream1=morph, Stream2=move_18.Geometry)
graft_5 = GraftTree(Tree=rev, IncludeEmptyLists=True, IncludeNullItems=True)
filter_4 = StreamFilter(Gate=list, Stream0=pt_13, Stream1=pt_10, Stream2=graft_5)
points_3 = PointList(Points=rev, Size=Slider(100, range=0..100))
xy_2 = XYPlane(Origin=filter_4)
align_2 = AlignPlane(Plane=xy_2, Direction=Y_6)  # -> Plane, Angle
move_19 = Move(Geometry=align_2.Plane, Motion=Z_8)  # -> Geometry, Transform
filter_5 = StreamFilter(Gate=list, Stream0=move_17.Geometry, Stream1=move_19.Geometry, Stream2=move_19.Geometry)
panel_43 = Panel(filter_5)
lng_9 = ListLength(List=filter_5)

# ---- group: angle positioning / Start Vacuum
set_digital = KUKAPrcSetDigitalOut(
    DigitalOut1=False,
    DigitalOut2=Toggle(True),
    DigitalOut3=False,
    DigitalOut4=False,
    DigitalOut5=False,
    DigitalOut6=False,
    DigitalOut7=False,
    DigitalOut8=False,
    ContinuousMovement=False)
dup = DuplicateData(Data=set_digital, Number=lng_9, Order=True)

# ---- group: angle positioning / Stop Vacuum
set_digital_2 = KUKAPrcSetDigitalOut(
    DigitalOut1=False,
    DigitalOut2=Toggle(False),
    DigitalOut3=False,
    DigitalOut4=False,
    DigitalOut5=False,
    DigitalOut6=False,
    DigitalOut7=False,
    DigitalOut8=False,
    ContinuousMovement=False)
dup_2 = DuplicateData(Data=set_digital_2, Number=lng_9, Order=True)

# ---- group: angle positioning / Safety Distance above Targetblock
ptp_move = KUKAPrcPTPMovement(TargetAsPlane=move_17.Geometry, extaxenabled=False, interpolation="C_PTP")

# ---- group: angle positioning / Safety Distance over Pick Up Point
ptp_move_2 = KUKAPrcPTPMovement(TargetAsPlane=move_19.Geometry, extaxenabled=False, interpolation="C_PTP")
dup_3 = DuplicateData(Data=ptp_move_2, Number=lng_9, Order=True)

# ---- group: angle positioning / At Targetblock
lin_move = KUKAPrcLINearMovement(TargetAsPlane=clean_11, extaxenabled=False, interpolation="C_DIS")

# ---- group: angle positioning / Point for Pick Up
lin_move_2 = KUKAPrcLINearMovement(TargetAsPlane=align_2.Plane, extaxenabled=False, interpolation="C_DIS")
dup_4 = DuplicateData(Data=lin_move_2, Number=lng_9, Order=True)

# ----
preview_13 = CustomPreview(Geometry=filter_3, Material=filter_2)  # disabled

# ---- group: WS_2 Excel
geo_12 = Geometry(item_19.Item1)
area_20 = Area(Geometry=geo_12)  # -> Area, flatten(Centroid)
pdecon_6 = Deconstruct(Point=area_20.Centroid)  # -> flatten(XComponent), flatten(YComponent), flatten(ZComponent)
lng_10 = ListLength(List=pdecon_6.XComponent)
repeat_9 = RepeatData(Data=robot_all_positions_2.Item1, Length=lng_10)  # -> flatten(Data)
repeat_10 = RepeatData(Data=robot_all_positions.Item1, Length=lng_10)  # -> flatten(Data)
concat_5 = Concatenate(FragmentA="WS_2_", FragmentB=int_2)
flatten_8 = FlattenTree(Tree=concat_5, Path="{0}")
panel_44 = Panel(panel_13)
panel_45 = Panel("Placing TAG(ID-CODE)")
panel_46 = Panel(panel_9)
panel_47 = Panel(panel_12)
panel_48 = Panel(panel_11)
panel_49 = Panel(panel_10)
merge_21 = Merge(Data1=panel_44, Data2=repeat_10)
merge_22 = Merge(Data1=panel_45, Data2=flatten_8)
merge_23 = Merge(Data1=panel_46, Data2=pdecon_6.XComponent)
merge_24 = Merge(Data1=panel_49, Data2=pdecon_6.YComponent)
merge_25 = Merge(Data1=panel_48, Data2=pdecon_6.ZComponent)
merge_26 = Merge(Data1=panel_47, Data2=repeat_9)
path_mapper_17 = PathMapper(merge_22, source="{C}", target="{0;c}")
path_mapper_18 = PathMapper(merge_21, source="{C}", target="{5;c}")
path_mapper_19 = PathMapper(merge_23, source="{C}", target="{1;c}")
path_mapper_20 = PathMapper(merge_24, source="{C}", target="{2;c}")
path_mapper_21 = PathMapper(merge_25, source="{C}", target="{3;c}")
path_mapper_22 = PathMapper(merge_26, source="{C}", target="{4;c}")

repeat_11 = RepeatData(Data=panel_30, Length=lng_10)  # -> flatten(Data)
repeat_12 = RepeatData(Data=panel_29, Length=lng_10)  # -> flatten(Data)
repeat_13 = RepeatData(Data=panel_31, Length=lng_10)  # -> flatten(Data)
panel_50 = Panel(panel_32)
panel_51 = Panel(panel_33)
panel_52 = Panel(panel_34)
merge_27 = Merge(Data1=panel_50, Data2=repeat_11)
merge_28 = Merge(Data1=panel_51, Data2=repeat_12)
merge_29 = Merge(Data1=panel_52, Data2=repeat_13)
path_mapper_23 = PathMapper(merge_27, source="{C}", target="{6;c}")
path_mapper_24 = PathMapper(merge_29, source="{C}", target="{8;c}")
path_mapper_25 = PathMapper(merge_28, source="{C}", target="{7;c}")

merge_30 = Merge(
    Data1=path_mapper_17,
    Data2=path_mapper_19,
    Data3=path_mapper_20,
    Data4=path_mapper_21,
    Data5=path_mapper_22,
    Data6=path_mapper_18,
    Data7=path_mapper_23,
    Data8=path_mapper_25,
    Data9=path_mapper_24)
write_3 = ExcelWrite(
    Start=button_2,
    FilePath=panel_2,
    SheetName="Workstation_2",
    Title="Workstation_2 Robot-arm/Facade location Quantity take-off",
    Cell="A1",
    Data=merge_30)

# ---- group: WS_2 Excel / WS_3 Excel
geo_13 = Geometry(item_19.Item2)
area_21 = Area(Geometry=geo_13)  # -> Area, flatten(Centroid)
pdecon_7 = Deconstruct(Point=area_21.Centroid)  # -> flatten(XComponent), flatten(YComponent), flatten(ZComponent)
lng_11 = ListLength(List=pdecon_7.XComponent)
repeat_14 = RepeatData(Data=robot_all_positions_2.Item2, Length=lng_11)  # -> flatten(Data)
repeat_15 = RepeatData(Data=robot_all_positions.Item2, Length=lng_11)  # -> flatten(Data)
concat_6 = Concatenate(FragmentA="WS_3_", FragmentB=int_2)
flatten_9 = FlattenTree(Tree=concat_6, Path="{0}")
panel_53 = Panel(panel_13)
panel_54 = Panel("Placing TAG(ID-CODE)")
panel_55 = Panel(panel_9)
panel_56 = Panel(panel_12)
panel_57 = Panel(panel_11)
panel_58 = Panel(panel_10)
merge_31 = Merge(Data1=panel_53, Data2=repeat_15)
merge_32 = Merge(Data1=panel_54, Data2=flatten_9)
merge_33 = Merge(Data1=panel_55, Data2=pdecon_7.XComponent)
merge_34 = Merge(Data1=panel_58, Data2=pdecon_7.YComponent)
merge_35 = Merge(Data1=panel_57, Data2=pdecon_7.ZComponent)
merge_36 = Merge(Data1=panel_56, Data2=repeat_14)
path_mapper_26 = PathMapper(merge_32, source="{C}", target="{0;c}")
path_mapper_27 = PathMapper(merge_31, source="{C}", target="{5;c}")
path_mapper_28 = PathMapper(merge_33, source="{C}", target="{1;c}")
path_mapper_29 = PathMapper(merge_34, source="{C}", target="{2;c}")
path_mapper_30 = PathMapper(merge_35, source="{C}", target="{3;c}")
path_mapper_31 = PathMapper(merge_36, source="{C}", target="{4;c}")

repeat_16 = RepeatData(Data=panel_30, Length=lng_11)  # -> flatten(Data)
repeat_17 = RepeatData(Data=panel_29, Length=lng_11)  # -> flatten(Data)
repeat_18 = RepeatData(Data=panel_31, Length=lng_11)  # -> flatten(Data)
panel_59 = Panel(panel_32)
panel_60 = Panel(panel_33)
panel_61 = Panel(panel_34)
merge_37 = Merge(Data1=panel_59, Data2=repeat_16)
merge_38 = Merge(Data1=panel_60, Data2=repeat_17)
merge_39 = Merge(Data1=panel_61, Data2=repeat_18)
path_mapper_32 = PathMapper(merge_37, source="{C}", target="{6;c}")
path_mapper_33 = PathMapper(merge_39, source="{C}", target="{8;c}")
path_mapper_34 = PathMapper(merge_38, source="{C}", target="{7;c}")

merge_40 = Merge(
    Data1=path_mapper_26,
    Data2=path_mapper_28,
    Data3=path_mapper_29,
    Data4=path_mapper_30,
    Data5=path_mapper_31,
    Data6=path_mapper_27,
    Data7=path_mapper_32,
    Data8=path_mapper_34,
    Data9=path_mapper_33)
write_4 = ExcelWrite(
    Start=button_2,
    FilePath=panel_2,
    SheetName="Workstation_3",
    Title="Workstation_3 Robot-arm/Facade location Quantity take-off",
    Cell="A1",
    Data=merge_40)

# ---- group: kuka commands
# Sequence:
# 
# Go above pick up
# Go to pick up
# Start vacuum
# Go above pick up
# Go above target
# Go down to target
# Stop vacuum
# Go above target
cmd_weave = CommandWeaver(
    Command1=dup_3,
    Command2=dup_4,
    Command3=dup,
    Command4=dup_3,
    Command5=ptp_move,
    Command6=lin_move,
    Command7=dup_2,
    Command8=ptp_move,
    enabletree=False)  # -> flatten(WovenList)
brep_5 = Brep([<brep referenced from the Rhino model> x164])  # disabled
mesh_14 = MeshBrep(
    Brep=brep_5,
    Settings={GridMaxCount=0, GridMinCount=16, JaggedSeams=False, MaxEdgeLength=0, MinEdgeLength=0.0001, MinTolerance=0, Refine=True, RefineAngle=0, RelativeTolerance=0.65, SimplePlanes=True, Tolerance=0})  # disabled
mjoin = MeshJoin(Meshes=mesh_14)  # disabled
number_slider_18 = Slider(0.902, range=0..1)
custom_tool_2 = CustomToolForKUKAPrc(
    CustomToolGeometry=mjoin,
    toolid=7,
    toolvala=0,
    toolvalb=0,
    toolvalc=270,
    toolvalx=356.739,
    toolvaly=0,
    toolvalz=276.975,
    valuesset=True)  # disabled
play = KUKAPrcPlay(Loop=False, Reset=False, savedtime=0)

# ----
kuka_prc = KUKAPrcCORE(
    SimulationSlider=number_slider_18,
    KUKAPrcCommands=cmd_weave,
    Tool=custom_tool,
    Robot=filter,
    CollisionGeometry=flatten,
    PRC_BaseExpose=False,
    PRC_SaveNameExpose=False,
    PRCsettings="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")  # -> RobotGeometry, AnalysisOutput

# ---- group: kuka commands (continued)
analysis = AnalysisKUKAPrc(KUKAPrcAnalysisData=kuka_prc.AnalysisOutput)  # -> RobotAxisValues, RobotCollisionCheck, RobotReachabilityCheck, CommandID, TimeValue, Planes, CommandTags, IOState, Index, KRL

# ----
# ROBOT COLLISION CHECK (COLLISION) AS TREE
# 
# if the value is 1, KUKA|prc has caclulated a collision at the particular robot joint
flatten_10 = FlattenTree(Tree=analysis.RobotCollisionCheck, Path="{0}")
# REACHABILITY
# if the value is 1, KUKA prc has calculated that the robot cannot reach a given position
flatten_11 = FlattenTree(Tree=analysis.RobotReachabilityCheck, Path="{0}")
# TIME VALUE (TIME) AS A TREE
# 
# command ID of each simulated command
# it is the speed value
# Hello,
# 
# As KUKA doesn't publish any acceleration and deceleration ramps, the time is simply distance/speed. The unit is seconds.
# So it's not super accurate for processes that often change speed, but relatively precise for processes with constant speed such as extrusion.
# You can use e.g. the last time value for Galapagos to optimize the process time.
# 
# Best,
# Johannes
# initial total time before optimization
# 3682.506232
flatten_12 = FlattenTree(Tree=analysis.TimeValue, Path="{0}")
ma_4 = MassAddition(Input=flatten_10)  # -> Result, PartialResults
panel_62 = Panel(ma_4.Result)
ma_5 = MassAddition(Input=flatten_11)  # -> Result, PartialResults
ma_6 = MassAddition(Input=flatten_12)  # -> Result, PartialResults
panel_63 = Panel(ma_4.Result)
panel_64 = Panel(ma_5.Result)
panel_65 = Panel(ma_6.Result)
bbox_5 = BoundingBox(Content=kuka_prc.RobotGeometry, Plane=PlaneXY(0, 0, 0), UnionBox=True)  # -> Box, Box_2
mesh_15 = Mesh(flatten(bbox_5.Box))
ma_7 = MassAddition(Input=panel_65)  # -> Result, PartialResults
time_value_2 = Number(expr("x", flatten(ma_7.Result)))

ma_8 = MassAddition(Input=[ma_4.Result, ma_5.Result, "0"])  # -> Result, PartialResults
not = GateNot(A=ma_8.Result)

# ---- group: boolean hard constraint
bool = Boolean(not)

# ----
panel_66 = Panel(bool)

# ---- group: WS_2 Excel / WS_4 Excel
geo_14 = Geometry(item_19.Item3)
area_22 = Area(Geometry=geo_14)  # -> Area, flatten(Centroid)
pdecon_8 = Deconstruct(Point=area_22.Centroid)  # -> flatten(XComponent), flatten(YComponent), flatten(ZComponent)
lng_12 = ListLength(List=pdecon_8.XComponent)
repeat_19 = RepeatData(Data=robot_all_positions_2.Item3, Length=lng_12)  # -> flatten(Data)
repeat_20 = RepeatData(Data=robot_all_positions.Item3, Length=lng_12)  # -> flatten(Data)
concat_7 = Concatenate(FragmentA="WS_4_", FragmentB=int_2)
flatten_13 = FlattenTree(Tree=concat_7, Path="{0}")
panel_67 = Panel(panel_13)
panel_68 = Panel("Placing TAG(ID-CODE)")
panel_69 = Panel(panel_9)
panel_70 = Panel(panel_12)
panel_71 = Panel(panel_11)
panel_72 = Panel(panel_10)
merge_41 = Merge(Data1=panel_67, Data2=repeat_20)
merge_42 = Merge(Data1=panel_68, Data2=flatten_13)
merge_43 = Merge(Data1=panel_69, Data2=pdecon_8.XComponent)
merge_44 = Merge(Data1=panel_72, Data2=pdecon_8.YComponent)
merge_45 = Merge(Data1=panel_71, Data2=pdecon_8.ZComponent)
merge_46 = Merge(Data1=panel_70, Data2=repeat_19)
path_mapper_35 = PathMapper(merge_42, source="{C}", target="{0;c}")
path_mapper_36 = PathMapper(merge_41, source="{C}", target="{5;c}")
path_mapper_37 = PathMapper(merge_43, source="{C}", target="{1;c}")
path_mapper_38 = PathMapper(merge_44, source="{C}", target="{2;c}")
path_mapper_39 = PathMapper(merge_45, source="{C}", target="{3;c}")
path_mapper_40 = PathMapper(merge_46, source="{C}", target="{4;c}")

repeat_21 = RepeatData(Data=panel_30, Length=lng_12)  # -> flatten(Data)
repeat_22 = RepeatData(Data=panel_29, Length=lng_12)  # -> flatten(Data)
repeat_23 = RepeatData(Data=panel_31, Length=lng_12)  # -> flatten(Data)
panel_73 = Panel(panel_32)
panel_74 = Panel(panel_33)
panel_75 = Panel(panel_34)
merge_47 = Merge(Data1=panel_73, Data2=repeat_21)
merge_48 = Merge(Data1=panel_74, Data2=repeat_22)
merge_49 = Merge(Data1=panel_75, Data2=repeat_23)
path_mapper_41 = PathMapper(merge_47, source="{C}", target="{6;c}")
path_mapper_42 = PathMapper(merge_49, source="{C}", target="{8;c}")
path_mapper_43 = PathMapper(merge_48, source="{C}", target="{7;c}")

merge_50 = Merge(
    Data1=path_mapper_35,
    Data2=path_mapper_37,
    Data3=path_mapper_38,
    Data4=path_mapper_39,
    Data5=path_mapper_40,
    Data6=path_mapper_36,
    Data7=path_mapper_41,
    Data8=path_mapper_43,
    Data9=path_mapper_42)
write_5 = ExcelWrite(
    Start=button_2,
    FilePath=panel_2,
    SheetName="Workstation_4",
    Title="Workstation_4 Robot-arm/Facade location Quantity take-off",
    Cell="A1",
    Data=merge_50)

# ----
# the values are negated (multiplied by -1) to maximize the values, because octopus always performs minimizations.
sqr_3 = Square(Value=panel_63)
sqr_4 = Square(Value=panel_64)
# Speed is a measure of how quickly an object moves from one place to another. It is equal to the distance traveled divided by the time. It is possible to find any of these three values using the other two. ... To find the speed, distance is over time in the triangle, so speed is distance divided by time.
ma_9 = MassAddition(Input=[ma_4.Result, ma_5.Result])  # -> Result, PartialResults
ma_10 = MassAddition(Input=sqr_3)  # -> Result, PartialResults
ma_11 = MassAddition(Input=sqr_4)  # -> Result, PartialResults
robot_reachability_2 = Number(expr("x", flatten(ma_11.Result)))
collision_detection_3 = Number(expr("x", flatten(ma_10.Result)))
not_2 = GateNot(A=ma_9.Result)
merge_51 = Merge(Data1=collision_detection_3, Data2=robot_reachability_2, Data3=time_value_2)
# merge objective one and two
# 
# because both collision and reachability should have the value 0 which is equal to true value in the boolean component
merge_52 = Merge(Data1="Collision", Data2="Reachability", Data3="Time Value")

# ---- group: boolean hard constraint
# GD total time before optimization
# 6560.287403
# GD total time before optimization
# 6560.287403
bool_2 = Boolean(not_2)

# ---- group: textual objectives description
txt_2 = Text(merge_52)

# ---- group: numeric objective values
collision_detection_4 = Number(merge_51)

# ----
ma_12 = MassAddition(Input=[collision_detection_3, robot_reachability_2])  # -> Result, PartialResults

panel_76 = Panel(txt_2)
panel_77 = Panel(collision_detection_4)
panel_78 = Panel(bool_2)

collision_and_reachability_check = Number(expr("x", flatten(ma_12.Result)))
wallacei_x = WallaceiX(
    Genes=[pick_xy_coordinates, place_xy_coordinates, pick_rotation_angle],
    Objectives=[collision_detection_3, robot_reachability_2, time_value_2],
    Phenotype=mesh_12,
    allFitness="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",
    allFrontIdx="112|16;116|12;128|19;135|18;145|18;165|16;179|18;181|19;183|19;184|19;200|18;235|18;252|11;255|18;256|14;259|16;260|2;260|16;261|19;263|18;269|10;270|18;274|19;279|16;280|10;292|8;307|19;316|17;319|17;350|11;352|18;356|19;377|5;387|6;404|7;411|17;418|1;418|18;422|2;435|19;438|10;443|18;444|19;445|18;448|18;454|11;454|18;456|6;459|11;460|7;460|17;460|19;463|15;465|7;466|17;469|7;473|12;475|14;477|2;480|13;481|7;481|12;482|18;484|0;485|8;486|3;486|9;486|18;488|14;492|13;492|17;493|16;494|16;494|17;495|16;495|19;496|19;498|17;499|19",
    allGenomes="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",
    curFrontIdx="499|0;499|1;499|2;499|3;499|4;499|5;499|6;499|7;499|8;499|9;499|10;499|11;499|12;499|13;499|14;499|15;499|16;499|17;499|18;499|19",
    curFrontIdxSave="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",
    popGen="20,500",
    total="18559906",
    wlcDone=True)  # -> WallaceiGenomes, FitnessValues, Data, WPhenotypes

# ==== cluster Remap: Remaps numbers
data = ClusterInput()
min = ClusterInput()
max = ClusterInput()
bnd = Bounds(Numbers=data)
dom = ConstructDomain(DomainStart=min, DomainEnd=max)
remap = RemapNumbers(Value=data, Source=bnd, Target=dom)  # -> Mapped, Clipped
R = ClusterOutput(remap.Mapped)
